vi "AMEnvelopeDetection.gvi"   [LabVIEW Communications System Design Suite 2.0.1]
inputs:
  "AM signal": waveform<f64> = {dt=1, Y=[]}
  "Low cutoff frequency": f64 = 0.125
  "order": i32 = 2
  "error in": error
outputs:
  "Demodulated Signal": waveform<f64>
  "Demodulated Signal PSD": T1
  "error out": error
panel indicators:
  "loop count": i32
  "product": f64
  "x": f64
  "output waveform": waveform<f64>
types:
  T1 = cluster{"f0": f64, "df": f64, "magnitude": f64[]}
uses:
  NI::Analysis::Filtering::Butterworth Lowpass Filter (Waveform).gvi
  NI::Analysis::Measurement::Power Spectral Density for 1 Chan.gvi
diagram:
  Merge Errors($"error in") -> (error out=w1)
  $"error out" <- w1
  Waveform Array Size(waveform=$"AM signal") -> (size=w2)
  $"loop count" <- w2
  Waveform Multiply($"AM signal", 3.14159265359) -> w3
  Property Node(instance in=w3) -> ("Y"=w4, "t0"=w5, "dt"=w6)
  for (N = w2) {
    w7 = each element of w4
    $x <- w7
    Is Less Than 0(x=w7) -> w9
    case (w9) {
      frame False, Default {
        w10 = 1
      }
      frame True {
        w10 = 0
      }
    }
    Multiply(w10, w7) -> w11
    $product <- w11
    append w11 to w8
  }
  Build Waveform Node(Y=w8, dt=w6, t0=w5) -> (output waveform=w12)
  $"output waveform" <- w12
  call "Butterworth Lowpass Filter (Waveform).gvi"(signal=w12, cutoff frequency=$"Low cutoff frequency", order=$order) -> (filtered signal=w13)
  $"Demodulated Signal" <- w13
  call "Power Spectral Density for 1 Chan.gvi"(signal=w13) -> (power spectral density=w14)
  $"Demodulated Signal PSD" <- w14
