vi "FM_Demodulator.gvi"   [LabVIEW Communications System Design Suite 2.0.1]
inputs:
  "waveform in": waveform<f64> = {dt=1, Y=[]}
  "Low cutoff frequency": f64 = 0.125
  "order": i32 = 2
outputs:
  "Demodulated Signal": waveform<f64>
  "Demodulated Signal PSD": T1
types:
  T1 = cluster{"f0": f64, "df": f64, "magnitude": f64[]}
uses:
  NI::Analysis::IntegralDifferentiation::Derivative x(t).gvi
diagram:
  Property Node(instance in=$"waveform in") -> ("Y"=w1, "dt"=w2)
  call "Derivative x(t).gvi"(x(t)=w1, dt=w2) -> (dx(t)/dt=w3)
  Build Waveform Node(Y=w3, dt=w2) -> (output waveform=w4)
  call "AMEnvelopeDetection.gvi"(AM signal=w4, Low cutoff frequency=$"Low cutoff frequency", order=$order) -> (Demodulated Signal=w5, Demodulated Signal PSD=w6)
  $"Demodulated Signal" <- w5
  $"Demodulated Signal PSD" <- w6
