vi "FM_Modulator.gvi"   [LabVIEW Communications System Design Suite 2.0.1]
panel controls:
  "frequency deviation": f64
  "carrier_amplitude": f64 = 1
  "carrier_frequency": f64 = 10
  "carrier_phase": f64
  "carrier_samples": i32 = 1000
  "carrier_sample rate": f64 = 1000
  "msg_amplitude_2": f64 = 1
  "msg_frequency_2": f64 = 10
  "msg_phase_2": f64
  "msg_samples_2": i32 = 1000
  "msg_rate_2": f64 = 1000
panel indicators:
  "Two cosines": f64[]
  "Two Sines": f64[]
  "FM modulated": f64[]
  "carrier Signal_2": waveform<f64>
  "message Signal": waveform<f64>
  "power spectral density": T1
  "product": f64
types:
  T1 = cluster{"f0": f64, "df": f64, "magnitude": f64[]}
uses:
  NI::Analysis::Generation::Sine Waveform.gvi
  NI::Analysis::IntegralDifferentiation::Integral x(t).gvi
  NI::Analysis::Measurement::Power Spectral Density for 1 Chan.gvi
diagram:
  call "Sine Waveform.gvi"(amplitude=$carrier_amplitude, frequency=$carrier_frequency, phase in=$carrier_phase, sample rate=$"carrier_sample rate", samples=$carrier_samples) -> (sine wave=w1)
  $"carrier Signal_2" <- w1
  Property Node(instance in=w1)
  call "Sine Waveform.gvi"(amplitude=$msg_amplitude_2, frequency=$msg_frequency_2, phase in=$msg_phase_2, sample rate=$msg_rate_2, samples=$msg_samples_2) -> (sine wave=w2)
  Property Node(instance in=w2) -> ("t0"=w3, "dt"=w4, instance out=w5)
  Multiply($carrier_frequency, 6.28318531) -> w6
  Multiply(w4, w6) -> w7
  $product <- w7
  Multiply($"frequency deviation", 6.28) -> w8
  call "Integral x(t).gvi"(x(t)=w5, dt=w4) -> (integral x(t)=w9)
  Multiply(w8, w9) -> w10
  Add(w7, w10) -> w11
  # w12: Cos (fc + theta)
  Cosine(x=w11) -> w12
  Subtract(x=w7, y=w10) -> w13
  # w14: Cos (fc - theta)
  Cosine(x=w13) -> w14
  Add(w14, w12) -> w15
  Multiply(w15, 0.5) -> w16
  $"Two cosines" <- w16
  Subtract(x=w12, y=w14) -> w17
  Multiply(w17, 0.5) -> w18
  Subtract(x=w16, y=w18) -> w19
  $"FM modulated" <- w19
  call "Power Spectral Density for 1 Chan.gvi"(signal=w19) -> (power spectral density=w20)
  $"power spectral density" <- w20
  Build Waveform Node(Y=w19, dt=w4, t0=w3)
  $"Two Sines" <- w18
  $"message Signal" <- w5
