vi "FM_Modulator_2.gvi"   [LabVIEW Communications System Design Suite 2.0.1]
inputs:
  "msg_amplitude": f64 = 1
  "Delta_F": f64
  "msg_phase": f64
  "msg_frequency": f64 = 10
  "msg_samples": i32 = 1000
  "msg_rate": f64 = 1000
  "carrier_amplitude": f64 = 1
  "carrier_frequency": f64 = 10
  "carrier_samples": i32 = 1000
  "carrier_sample rate": f64 = 1000
outputs:
  "power spectral density of S(t)": T1
  "S(t)": waveform<f64>
  "Msg Signal": waveform<f64>
panel indicators:
  "Cos(2pifct)": waveform<f64>
  "Sin(2pifct)": waveform<f64>
  "Integral m(t)_2": f64[]
  "Theta": f64[]
types:
  T1 = cluster{"f0": f64, "df": f64, "magnitude": f64[]}
uses:
  NI::Analysis::Generation::Sine Waveform.gvi
  NI::Analysis::IntegralDifferentiation::Integral x(t).gvi
  NI::Analysis::Measurement::Power Spectral Density for 1 Chan.gvi
diagram:
  call "Sine Waveform.gvi"(amplitude=$carrier_amplitude, frequency=$carrier_frequency, phase in=90, sample rate=$"carrier_sample rate", samples=$carrier_samples) -> (sine wave=w1)
  $"Cos(2pifct)" <- w1
  call "Sine Waveform.gvi"(amplitude=$msg_amplitude, frequency=$msg_frequency, phase in=$msg_phase, sample rate=$msg_rate, samples=$msg_samples) -> (sine wave=w2)
  Property Node(instance in=w2) -> ("Y"=w3, "dt"=w4)
  call "Integral x(t).gvi"(x(t)=w3, dt=w4) -> (integral x(t)=w5)
  Multiply(w5, 6.28319) -> w6
  Multiply(w6, $Delta_F) -> w7
  Cosine(x=w7) -> w8
  Build Waveform Node(Y=w8, dt=w4) -> (output waveform=w9)
  Waveform Multiply(w1, w9) -> w10
  call "Sine Waveform.gvi"(amplitude=$carrier_amplitude, frequency=$carrier_frequency, phase in=0, sample rate=$"carrier_sample rate", samples=$carrier_samples) -> (sine wave=w11)
  Sine(x=w7) -> w12
  Build Waveform Node(Y=w12, dt=w4) -> (output waveform=w13)
  Waveform Multiply(w11, w13) -> w14
  Waveform Subtract(x=w10, y=w14) -> w15
  $"S(t)" <- w15
  $"Sin(2pifct)" <- w11
  call "Power Spectral Density for 1 Chan.gvi"(signal=w15) -> (power spectral density=w16)
  $"power spectral density of S(t)" <- w16
  $"Msg Signal" <- w2
  $"Integral m(t)_2" <- w5
  $Theta <- w7
