vi "FM_Top.gvi"   [LabVIEW Communications System Design Suite 2.0.1]
panel controls:
  "stop": bool
  "Delta_F": f64
  "msg_phase": f64
  "msg_amplitude": f64 = 1
  "msg_frequency": f64 = 10
  "msg_samples": i32 = 1000
  "msg_rate": f64 = 1000
  "carrier_amplitude": f64 = 1
  "carrier_frequency": f64 = 10
  "carrier_samples": i32 = 1000
  "carrier_sample rate": f64 = 1000
  "order": i32 = 2
  "Low cutoff frequency": f64 = 0.125
panel indicators:
  "Demodulated Signal": waveform<f64>
  "PSD_S(t)": T1
  "PSD_after_Demodulation": T1
  "S(t)": waveform<f64>
  "Msg Signal": waveform<f64>
  "Graph": f64[]
types:
  T1 = cluster{"f0": f64, "df": f64, "magnitude": f64[]}
diagram:
  while {
    call "FM_Modulator_2.gvi"(msg_amplitude=$msg_amplitude, Delta_F=$Delta_F, msg_phase=$msg_phase, msg_frequency=$msg_frequency, msg_samples=$msg_samples, msg_rate=$msg_rate, carrier_amplitude=$carrier_amplitude, carrier_frequency=$carrier_frequency, carrier_samples=$carrier_samples, carrier_sample rate=$"carrier_sample rate") -> (power spectral density of S(t)=w1, S(t)=w2, Msg Signal=w3)
    $"PSD_S(t)" <- w1
    Multiply(6.28319, $Delta_F) -> w4
    Multiply($carrier_frequency, 6.28319) -> w5
    Waveform Divide(x=w2, y=$msg_amplitude) -> w6
    call "FM_Demodulator.gvi"(waveform in=w6, Low cutoff frequency=$"Low cutoff frequency", order=$order) -> (Demodulated Signal=w7, Demodulated Signal PSD=w8)
    Waveform Subtract(x=w7, y=w5) -> w9
    Waveform Divide(x=w9, y=w4) -> w10
    $"Demodulated Signal" <- w10
    $"S(t)" <- w2
    $PSD_after_Demodulation <- w8
    $"Msg Signal" <- w3
    stop if $stop
  }
