vi "BPSK reciever.gvi"   [LabVIEW Communications System Design Suite 2.0.1]
panel controls:
  "IQ rate": f64 = 200000
  "device names": "niUSRPClass"
  "carrier frequency": f64 = 400000000
  "gain Tx": f64
  "active antenna Tx": string = "TX1"
  "stop Tx": bool
  "gain Rx": f64
  "active antenna Rx": string = "RX2"
  "pulse shaping filter": T2 = "none"
  "Mesage length_2": i32 = 128
  "index": i32
panel indicators:
  "Symbol rate": i32
  "L": f64
  "Baseband_waveform": f64[]
  "Baseband Power Spectrum": T1
  "In_Graph": f64[]
  "BER": f64
  "trigger found?": bool
  "output bit stream": i8[]
  "subarray": i16[]
types:
  T1 = cluster{"f0": f64, "df": f64, "magnitude": f64[]}
  T2 = enum{"none", "Raised Cosine", "Root Raised Cos", "Gaussian"}
uses:
  NI::Analysis::Resampling::Upsample (DBL).gvi
  NI::Analysis::Operations::1D Convolution (DBL).gvi
  NI::Analysis::Resampling::Decimate (single shot, CDB).gvi
diagram:
  Reciprocal(x=$"IQ rate") -> w1
  Reciprocal(x=10000) -> w2
  Multiply(w2, $"IQ rate") -> w3
  Random Number() -> (number (0 to 1)=w4)
  call "MT Generate Bits (Fibonacci, PN Order).gvi"(total bits=$"Mesage length_2", seed in=w4) -> (output bit stream=w5)
  Array Size(array=w5) -> (size(s)=w6)
  for (N = w6) {
    w7 = each element of w5
    case (w7) {
      frame 0, Default {
        w9 = -1
      }
      frame 1 {
        w9 = 1
      }
    }
    append w9 to w8
  }
  call "AddFrameHeader.gvi"(array=w8) -> (output array=w10)
  call "Upsample (DBL).gvi"(input array=w10, upsampling factor=w3) -> (upsampled array=w11)
  call "MT Generate Filter Coefficients.gvi"(pulse shaping filter=$"pulse shaping filter", pulse shaping samples per symbol=w3, modulation type="PSK") -> (pulse shaping filter coefficients=w12)
  call "1D Convolution (DBL).gvi"(x=w11, y=w12) -> (x * y=w13)
  w14 = cluster{"t0": timestamp, "dt": f64, "Y": c128[]} {all zero or empty}
  Property Node(instance in=w14, "dt"=w1, "Y"=w13) -> (instance out=w15)
  call "FFT Power Spectrum for 1 Chan (CDB)2.gvi"(time signal=w15) -> (power spectrum=w16)
  $"Baseband Power Spectrum" <- w16
  $L <- w3
  $"Symbol rate" <- 10000
  call "Quick Scale 1D.gvi"(X=w13) -> (Y[i]=X[i]/Max|X|=w17)
  $Baseband_waveform <- w17
  Build Waveform Node(Y=w13, dt=w1)
  $"output bit stream" <- w5
  $In_Graph <- w10
  call "niUSRP Open Rx Session.gvi"(device names=$"device names") -> (error out=w18, session handle out=w19)
  call "niUSRP Configure Signal.gvi"(session handle=w19, IQ rate=$"IQ rate", carrier frequency=$"carrier frequency", gain=$"gain Rx", error in=w18, active antenna=$"active antenna Rx") -> (session handle out=w20, coerced carrier frequency=w21, error out=w22)
  Subtract(x=w21, y=20000) -> w23
  Property Node(instance in=w20, "LO Frequency"=w23) -> (instance out=w24)
  call "niUSRP Initiate.gvi"(session handle=w24, error in=w22) -> (session handle out=w25, error out=w26)
  call "niUSRP Fetch Rx Data (CDB).gvi"(session handle=w25, number of samples=1000000, error in=w26) -> (session handle out=w27, data=w28, error out=w29)
  call "niUSRP Close Session.gvi"(session handle=w27, error in=w29)
  Divide(x=$"IQ rate", y=10000) -> w30
  call "MT Generate Filter Coefficients.gvi"(pulse shaping filter="Root Raised Cos", matched samples per symbol=w30, modulation type="PSK") -> (pulse shaping filter coefficients=w31)
  call "FrameSync.gvi"(Sampled Input=w28) -> (Aligned Samples=w32)
  call "Channel Estimator.gvi"(input signal=w32) -> (signal out=w33)
  Complex To Real Imaginary(x + iy=w33) -> (x=w34)
  call "1D Convolution (DBL).gvi"(x=w34, y=w31) -> (x * y=w35)
  call "PulseAlign.gvi"(Input signal=w35, Receiver Sampling Factor=w30) -> (aligned output=w36)
  call "Decimate (single shot, CDB).gvi"(input array=w36, decimating factor=w30) -> (decimated array=w37)
  Complex To Real Imaginary(x + iy=w37) -> (x=w38)
  call "FrameSync.gvi"(Sampled Input=w38) -> (Aligned Samples=w39)
  Complex To Real Imaginary(x + iy=w39) -> (x=w40)
  Is Greater Than 0(x=w40) -> w41
  Boolean To Integer(Boolean=w41) -> (0, 1=w42)
  Array Subset(array=w42, index0=$index, length0=$"Mesage length_2") -> w43
  $subarray <- w43
  call "MT Calculate BER After Trigger (Fibonacci PN Sequence).gvi"(input bit stream=w43, BER trigger threshold=0.4) -> (BER=w44, trigger found?=w45)
  $BER <- w44
  call "niUSRP Open Tx Session.gvi"(device names=$"device names") -> (session handle out=w46, error out=w47)
  call "niUSRP Configure Signal.gvi"(session handle=w46, IQ rate=$"IQ rate", carrier frequency=$"carrier frequency", gain=$"gain Tx", error in=w47, active antenna=$"active antenna Tx") -> (session handle out=w48, error out=w49)
  call "Insert Pilots.gvi"(signal input=w17) -> (output signal=w50)
  call "AddFrameHeader (complex).gvi"(array=w50) -> (output array=w51)
  while {
    call "niUSRP Write Tx Data (CDB).gvi"(session handle=w48, data=w51, error in=w49) -> (session handle out=w52, error out=w53)
    stop if $"stop Tx"
  }
  call "niUSRP Close Session.gvi"(session handle=w52, error in=w53)
  $"trigger found?" <- w45
  Array Size(array=w51) -> (size(s)=w54)
  Multiply(w54, 2)
