vi "BPSK_Tx_Rx_Template.gvi"   [LabVIEW Communications System Design Suite 2.0.1]
panel controls:
  "IQ rate": f64 = 200000
  "device names": "niUSRPClass"
  "carrier frequency": f64 = 400000000
  "gain Tx": f64
  "active antenna Tx": string = "TX1"
  "stop Tx": bool
  "gain Rx": f64
  "active antenna Rx": string = "RX2"
  "pulse shaping filter": T2 = "none"
  "Mesage length_2": i32 = 128
panel indicators:
  "Symbol rate": i32
  "L": f64
  "Plot graph here --> other two just tell it where to start recieving": f64[]
  "Baseband_waveform": f64[]
  "In_Graph": f64[]
  "Baseband Power Spectrum": T1
  "output_Waveform": waveform<f64>
types:
  T1 = cluster{"f0": f64, "df": f64, "magnitude": f64[]}
  T2 = enum{"none", "Raised Cosine", "Root Raised Cos", "Gaussian"}
uses:
  NI::Analysis::Resampling::Upsample (DBL).gvi
  NI::Analysis::Operations::1D Convolution (DBL).gvi
diagram:
  Reciprocal(x=$"IQ rate") -> w1
  Reciprocal(x=10000) -> w2
  Multiply(w2, $"IQ rate") -> w3
  Random Number() -> (number (0 to 1)=w4)
  call "MT Generate Bits (Fibonacci, PN Order).gvi"(total bits=$"Mesage length_2", seed in=w4) -> (output bit stream=w5)
  Array Size(array=w5) -> (size(s)=w6)
  for (N = w6) {
    w7 = each element of w5
    case (w7) {
      frame 0, Default {
        w9 = -1
      }
      frame 1 {
        w9 = 1
      }
    }
    append w9 to w8
  }
  call "AddFrameHeader.gvi"(array=w8) -> (output array=w10)
  call "Upsample (DBL).gvi"(input array=w10, upsampling factor=w3) -> (upsampled array=w11)
  call "MT Generate Filter Coefficients.gvi"(pulse shaping filter=$"pulse shaping filter", pulse shaping samples per symbol=w3, modulation type="PSK") -> (pulse shaping filter coefficients=w12)
  call "1D Convolution (DBL).gvi"(x=w11, y=w12) -> (x * y=w13)
  w14 = cluster{"t0": timestamp, "dt": f64, "Y": c128[]} {all zero or empty}
  Property Node(instance in=w14, "dt"=w1, "Y"=w13) -> (instance out=w15)
  call "FFT Power Spectrum for 1 Chan (CDB)2.gvi"(time signal=w15) -> (power spectrum=w16)
  $"Baseband Power Spectrum" <- w16
  $L <- w3
  $"Symbol rate" <- 10000
  call "Quick Scale 1D.gvi"(X=w13) -> (Y[i]=X[i]/Max|X|=w17)
  $"Plot graph here --> other two just tell it where to start recieving" <- w17
  $Baseband_waveform <- w17
  Build Waveform Node(Y=w13, dt=w1) -> (output waveform=w18)
  $output_Waveform <- w18
  $In_Graph <- w10
  call "niUSRP Open Rx Session.gvi"(device names=$"device names") -> (error out=w19, session handle out=w20)
  call "niUSRP Configure Signal.gvi"(session handle=w20, IQ rate=$"IQ rate", carrier frequency=$"carrier frequency", gain=$"gain Rx", error in=w19, active antenna=$"active antenna Rx") -> (session handle out=w21, coerced carrier frequency=w22, error out=w23)
  Subtract(x=w22, y=20000) -> w24
  Property Node(instance in=w21, "LO Frequency"=w24) -> (instance out=w25)
  call "niUSRP Initiate.gvi"(session handle=w25, error in=w23) -> (session handle out=w26, error out=w27)
  call "niUSRP Fetch Rx Data (CDB).gvi"(session handle=w26, number of samples=1000000, error in=w27) -> (session handle out=w28, error out=w29)
  call "niUSRP Close Session.gvi"(session handle=w28, error in=w29)
  call "niUSRP Open Tx Session.gvi"(device names=$"device names") -> (session handle out=w30, error out=w31)
  call "niUSRP Configure Signal.gvi"(session handle=w30, IQ rate=$"IQ rate", carrier frequency=$"carrier frequency", gain=$"gain Tx", error in=w31, active antenna=$"active antenna Tx") -> (session handle out=w32, error out=w33)
  call "Insert Pilots.gvi"(signal input=w17) -> (output signal=w34)
  call "AddFrameHeader (complex).gvi"(array=w34) -> (output array=w35)
  while {
    call "niUSRP Write Tx Data (CDB).gvi"(session handle=w32, data=w35, error in=w33) -> (session handle out=w36, error out=w37)
    stop if $"stop Tx"
  }
  call "niUSRP Close Session.gvi"(session handle=w36, error in=w37)
