vi "DPSK.gvi"   [LabVIEW Communications System Design Suite 2.0.1]
panel controls:
  "IQ rate": f64 = 200000
  "device names": "niUSRPClass"
  "carrier frequency": f64 = 400000000
  "gain Tx": f64
  "active antenna Tx": string = "TX1"
  "stop Tx": bool
  "gain Rx": f64
  "active antenna Rx": string = "RX2"
  "pulse shaping filter": T2 = "none"
  "Mesage length_2": i32 = 128
  "index": i32
panel indicators:
  "Symbol rate": i32
  "L": f64
  "DPSK_MOD": f64[]
  "Baseband Power Spectrum": T1
  "In_Graph": f64[]
  "BER": f64
  "trigger found?": bool
  "output bit stream": i8[]
  "subarray": i16[]
  "Graph": f64[]
  "out": f64[]
  "in": f64[]
  "in_2": c128[]
  "DPSK_DEMOD": f64[]
types:
  T1 = cluster{"f0": f64, "df": f64, "magnitude": f64[]}
  T2 = enum{"none", "Raised Cosine", "Root Raised Cos", "Gaussian"}
uses:
  NI::Analysis::Operations::1D Convolution (CDB).gvi
  NI::Analysis::Resampling::Decimate (single shot, CDB).gvi
  NI::Analysis::Resampling::Upsample (DBL).gvi
  NI::Analysis::Operations::1D Convolution (DBL).gvi
diagram:
  Random Number() -> (number (0 to 1)=w1)
  call "MT Generate Bits (Fibonacci, PN Order).gvi"(total bits=$"Mesage length_2", seed in=w1) -> (output bit stream=w2)
  s1 = i32[] []  # shift register
  for {
    w3 = each element of w2
    case (w3) {
      frame 0, Default {
        w4 = -1
      }
      frame 1 {
        w4 = 1
      }
    }
    Build Array[ConcatenateInputs=True](s1, w4) -> w5
    next s1 = w5
  }
  call "AddFrameHeader.gvi"(array=s1) -> (output array=w6)
  $in <- w6
  Initialize Array(element=1, size=1) -> w7
  s2 = w7  # shift register
  for (iteration -> i1) {
    w8 = each element of w6
    Array Index(array=s2) -> (out0[i1]=w9)
    Multiply(w9, w8) -> w10
    Build Array[ConcatenateInputs=True](s2, w10) -> w11
    next s2 = w11
  }
  $out <- s2
  Divide(x=$"IQ rate", y=10000) -> w12
  call "niUSRP Open Rx Session.gvi"(device names=$"device names") -> (error out=w13, session handle out=w14)
  call "niUSRP Configure Signal.gvi"(session handle=w14, IQ rate=$"IQ rate", carrier frequency=$"carrier frequency", gain=$"gain Rx", error in=w13, active antenna=$"active antenna Rx") -> (session handle out=w15, coerced carrier frequency=w16, error out=w17)
  Subtract(x=w16, y=20000) -> w18
  Property Node(instance in=w15, "LO Frequency"=w18) -> (instance out=w19)
  call "niUSRP Initiate.gvi"(session handle=w19, error in=w17) -> (session handle out=w20, error out=w21)
  call "niUSRP Fetch Rx Data (CDB).gvi"(session handle=w20, number of samples=1000000, error in=w21) -> (session handle out=w22, data=w23, error out=w24)
  call "MT Generate Filter Coefficients.gvi"(pulse shaping filter="Root Raised Cos", matched samples per symbol=w12, modulation type="PSK") -> (pulse shaping filter coefficients=w25)
  call "1D Convolution (CDB).gvi"(x=w23, y=w25) -> (x * y=w26)
  call "PulseAlign.gvi"(Input signal=w26, Receiver Sampling Factor=w12) -> (aligned output=w27)
  call "Decimate (single shot, CDB).gvi"(input array=w27, decimating factor=w12) -> (decimated array=w28)
  $in_2 <- w28
  Reciprocal(x=$"IQ rate") -> w29
  Reciprocal(x=10000) -> w30
  Multiply(w30, $"IQ rate") -> w31
  call "Upsample (DBL).gvi"(input array=s2, upsampling factor=w31) -> (upsampled array=w32)
  call "MT Generate Filter Coefficients.gvi"(pulse shaping filter=$"pulse shaping filter", pulse shaping samples per symbol=w31, modulation type="PSK") -> (pulse shaping filter coefficients=w33)
  call "1D Convolution (DBL).gvi"(x=w32, y=w33) -> (x * y=w34)
  w35 = cluster{"t0": timestamp, "dt": f64, "Y": c128[]} {all zero or empty}
  Property Node(instance in=w35, "dt"=w29, "Y"=w34) -> (instance out=w36)
  call "FFT Power Spectrum for 1 Chan (CDB)2.gvi"(time signal=w36) -> (power spectrum=w37)
  $"Baseband Power Spectrum" <- w37
  $L <- w31
  $"Symbol rate" <- 10000
  $DPSK_MOD <- s2
  $Graph <- w6
  Build Waveform Node(Y=w34, dt=w29)
  $In_Graph <- w6
  $"output bit stream" <- w2
  call "niUSRP Close Session.gvi"(session handle=w22, error in=w24)
  Array Size(array=w28) -> (size(s)=w38)
  Decrement(x=w38) -> w39
  s3 = c128[] []  # shift register
  for (N = w39) (iteration -> i2) {
    Increment(x=i2) -> w40
    Array Index(array=w28) -> (out0[w40]=w41)
    Array Index(array=w28) -> (out0[i2]=w42)
    Complex Conjugate(x + iy=w42) -> w43
    Multiply(w43, w41) -> w44
    Build Array[ConcatenateInputs=True](s3, w44) -> w45
    next s3 = w45
  }
  call "FrameSync.gvi"(Sampled Input=s3) -> (Aligned Samples=w46)
  Complex To Real Imaginary(x + iy=w46) -> (x=w47)
  Is Greater Than 0(x=w47) -> w48
  Boolean To Integer(Boolean=w48) -> (0, 1=w49)
  Array Subset(array=w49, index0=$index, length0=$"Mesage length_2") -> w50
  $subarray <- w50
  call "MT Calculate BER After Trigger (Fibonacci PN Sequence).gvi"(input bit stream=w50, BER trigger threshold=0.4) -> (BER=w51, trigger found?=w52)
  $BER <- w51
  call "niUSRP Open Tx Session.gvi"(device names=$"device names") -> (session handle out=w53, error out=w54)
  call "niUSRP Configure Signal.gvi"(session handle=w53, IQ rate=$"IQ rate", carrier frequency=$"carrier frequency", gain=$"gain Tx", error in=w54, active antenna=$"active antenna Tx") -> (session handle out=w55, error out=w56)
  call "Quick Scale 1D.gvi"(X=w34) -> (Y[i]=X[i]/Max|X|=w57)
  while {
    To Double Precision Complex(number=w57) -> w58
    call "niUSRP Write Tx Data (CDB).gvi"(session handle=w55, data=w58, error in=w56) -> (session handle out=w59, error out=w60)
    stop if $"stop Tx"
  }
  call "niUSRP Close Session.gvi"(session handle=w59, error in=w60)
  $"trigger found?" <- w52
  $DPSK_DEMOD <- w47
  Array Size(array=w57) -> (size(s)=w61)
  Multiply(w61, 0)
