vi "Error_correction.gvi"   [LabVIEW Communications System Design Suite 2.0.1]
panel controls:
  "IQ rate": f64 = 200000
  "device names": "niUSRPClass"
  "carrier frequency": f64 = 400000000
  "gain Tx": f64
  "active antenna Tx": string = "TX1"
  "stop Tx": bool
  "gain Rx": f64
  "active antenna Rx": string = "RX2"
  "pulse shaping filter": T2 = "none"
  "Mesage length_2": i32 = 128
  "Symbol rate_2": i32 = 10000
panel indicators:
  "Symbol rate": i32
  "L": f64
  "Baseband_waveform": f64[]
  "Baseband Power Spectrum": T1
  "In_Graph": f64[]
  "output bit stream": i8[]
  "subarray": i16[]
  "Variable: out_array": i32[]
  "x / y": f64
types:
  T1 = cluster{"f0": f64, "df": f64, "magnitude": f64[]}
  T2 = enum{"none", "Raised Cosine", "Root Raised Cos", "Gaussian"}
uses:
  NI::Analysis::Resampling::Upsample (DBL).gvi
  NI::Analysis::Operations::1D Convolution (DBL).gvi
  NI::Analysis::Resampling::Decimate (single shot, CDB).gvi
diagram:
  Reciprocal(x=$"IQ rate") -> w1
  Reciprocal(x=$"Symbol rate_2") -> w2
  Multiply(w2, $"IQ rate") -> w3
  Random Number() -> (number (0 to 1)=w4)
  call "MT Generate Bits (Fibonacci, PN Order).gvi"(total bits=$"Mesage length_2", seed in=w4) -> (output bit stream=w5)
  Build Array[ConcatenateInputs=True](w5, w5, w5) -> w6
  Array Size(array=w6) -> (size(s)=w7)
  for (N = w7) {
    w8 = each element of w6
    case (w8) {
      frame 0, Default {
        w10 = -1
      }
      frame 1 {
        w10 = 1
      }
    }
    append w10 to w9
  }
  call "AddFrameHeader.gvi"(array=w9) -> (output array=w11)
  call "Upsample (DBL).gvi"(input array=w11, upsampling factor=w3) -> (upsampled array=w12)
  call "MT Generate Filter Coefficients.gvi"(pulse shaping filter=$"pulse shaping filter", pulse shaping samples per symbol=w3, modulation type="PSK") -> (pulse shaping filter coefficients=w13)
  call "1D Convolution (DBL).gvi"(x=w12, y=w13) -> (x * y=w14)
  w15 = cluster{"t0": timestamp, "dt": f64, "Y": c128[]} {all zero or empty}
  Property Node(instance in=w15, "dt"=w1, "Y"=w14) -> (instance out=w16)
  call "FFT Power Spectrum for 1 Chan (CDB)2.gvi"(time signal=w16) -> (power spectrum=w17)
  $"Baseband Power Spectrum" <- w17
  $"Symbol rate" <- $"Symbol rate_2"
  $L <- w3
  call "Quick Scale 1D.gvi"(X=w14) -> (Y[i]=X[i]/Max|X|=w18)
  $Baseband_waveform <- w18
  Multiply($"Mesage length_2", 3) -> w19
  Divide(x=$"IQ rate", y=$"Symbol rate_2") -> w20
  call "MT Generate Filter Coefficients.gvi"(pulse shaping filter="Root Raised Cos", matched samples per symbol=w20, modulation type="PSK") -> (pulse shaping filter coefficients=w21)
  call "niUSRP Open Rx Session.gvi"(device names=$"device names") -> (error out=w22, session handle out=w23)
  call "niUSRP Configure Signal.gvi"(session handle=w23, IQ rate=$"IQ rate", carrier frequency=$"carrier frequency", gain=$"gain Rx", error in=w22, active antenna=$"active antenna Rx") -> (session handle out=w24, coerced carrier frequency=w25, error out=w26)
  Subtract(x=w25, y=20000) -> w27
  Property Node(instance in=w24, "LO Frequency"=w27) -> (instance out=w28)
  call "niUSRP Initiate.gvi"(session handle=w28, error in=w26) -> (session handle out=w29, error out=w30)
  call "niUSRP Fetch Rx Data (CDB).gvi"(session handle=w29, number of samples=1000000, error in=w30) -> (session handle out=w31, data=w32, error out=w33)
  call "FrameSync.gvi"(Sampled Input=w32) -> (Aligned Samples=w34)
  call "Channel Estimator.gvi"(input signal=w34) -> (signal out=w35)
  Complex To Real Imaginary(x + iy=w35) -> (x=w36)
  call "1D Convolution (DBL).gvi"(x=w36, y=w21) -> (x * y=w37)
  call "PulseAlign.gvi"(Input signal=w37, Receiver Sampling Factor=w20) -> (aligned output=w38)
  call "Decimate (single shot, CDB).gvi"(input array=w38, decimating factor=w20) -> (decimated array=w39)
  Complex To Real Imaginary(x + iy=w39) -> (x=w40)
  call "FrameSync.gvi"(Sampled Input=w40) -> (Aligned Samples=w41)
  Complex To Real Imaginary(x + iy=w41) -> (x=w42)
  Is Greater Than 0(x=w42) -> w43
  Boolean To Integer(Boolean=w43) -> (0, 1=w44)
  Array Subset(array=w44, index0=0, length0=w19) -> w45
  Math Node("array"=w45, "bits"=$"Mesage length_2") -> ("out_array"=w46)
  ~~~
  test1 = array(1:bits);
  test2 = array(bits+1:2*bits);
  test3 = array(bits*2+1:3*bits);

  out_array = zeros(1, bits);

  for i = 1:bits
      if (test1(1, i) + test2(1, i) + test3(1, i) >= 2)
          out_array(1, i) = 1;
      end
  end
  ~~~
  $"Variable: out_array" <- w46
  Build Waveform Node(Y=w14, dt=w1)
  $"output bit stream" <- w6
  $In_Graph <- w11
  call "niUSRP Close Session.gvi"(session handle=w31, error in=w33)
  $subarray <- w45
  s1 = 0  # shift register
  for {
    w47 = each element of w46
    w48 = each element of w5
    Is Not Equal(x=w47, y=w48) -> w49
    case (w49) {
      frame False, Default {
        w50 = s1
      }
      frame True {
        Add(s1, 1) -> w50
      }
    }
    next s1 = w50
  }
  Divide(x=s1, y=$"Mesage length_2") -> w51
  $"x / y" <- w51
  call "niUSRP Open Tx Session.gvi"(device names=$"device names") -> (session handle out=w52, error out=w53)
  call "niUSRP Configure Signal.gvi"(session handle=w52, IQ rate=$"IQ rate", carrier frequency=$"carrier frequency", gain=$"gain Tx", error in=w53, active antenna=$"active antenna Tx") -> (session handle out=w54, error out=w55)
  call "Insert Pilots.gvi"(signal input=w18) -> (output signal=w56)
  call "AddFrameHeader (complex).gvi"(array=w56) -> (output array=w57)
  while {
    call "niUSRP Write Tx Data (CDB).gvi"(session handle=w54, data=w57, error in=w55) -> (session handle out=w58, error out=w59)
    stop if $"stop Tx"
  }
  call "niUSRP Close Session.gvi"(session handle=w58, error in=w59)
  Array Size(array=w57) -> (size(s)=w60)
  Multiply(w60, 2)
