vi "CLT.gvi"   [LabVIEW Communications System Design Suite 2.0.1]
panel controls:
  "Wait_control": u32
  "number of bins": i32 = 10
  "Loop_var1": i32
  "Loop_var2": i32
  "Stop_at_iteration": i32
panel indicators:
  "histogram": T1
types:
  T1 = cluster{"x values": f64[], "histogram h(x)": f64[]}
uses:
  NI::Analysis::Statistics::Histogram (single-shot)(DBL Array).gvi
diagram:
  s1 = f64[] []  # shift register
  while (iteration -> i1) {
    Wait(time to wait=$Wait_control)
    w1 = $Loop_var1
    w2 = $"number of bins"
    for (N = w1) {
      w4 = $Loop_var2
      for (N = w4) {
        Random Number() -> (number (0 to 1)=w6)
        Subtract(x=w6, y=0.5) -> w7
        Multiply(w7, 1.73205081) -> w8
        Square Root(x=w2) -> w9
        Multiply(w8, w9) -> w10
        append w10 to w5
      }
      append w5 to w3
    }
    Add Array Elements(numeric array=w3) -> (sum=w11)
    Multiply(w4, w1) -> w12
    Divide(x=w11, y=w12) -> w13
    Insert Into Array(inArray=s1, index0=i1, new=w13) -> w14
    call "Histogram (single-shot)(DBL Array).gvi"(signal=w14, number of bins=w2) -> (histogram=w15)
    $histogram <- w15
    Is Equal(x=i1, y=$Stop_at_iteration) -> w16
    next s1 = w14
    stop if w16
  }
