vi "DataTypes.gvi"   [LabVIEW Communications System Design Suite 2.0.1]
panel controls:
  "string": string
panel indicators:
  "Hot?": bool
  "Avg. Temp (C)": f64
  "Converted output": f64[]
  "subarray": u8[]
diagram:
  String To Byte Array(string=$string) -> (unsigned byte array=w1)
  Array Subset(array=w1, index0=0, length0=3) -> w2
  $subarray <- w2
  Subtract(x=w2, y=32) -> w3
  Divide(x=w3, y=1.8) -> w4
  $"Converted output" <- w4
  Add Array Elements(numeric array=w4) -> (sum=w5)
  Array Size(array=w4) -> (size(s)=w6)
  Divide(x=w5, y=w6) -> w7
  $"Avg. Temp (C)" <- w7
  Is Greater Or Equal(x=w7, y=50) -> w8
  $"Hot?" <- w8
