vi "AM.gvi"   [LabVIEW Communications System Design Suite 2.0.1]
inputs:
  "m_frequency": f64 = 10
  "m_amplitude": f64 = 1
  "s_frequency": f64 = 10
  "s_amplitude": f64 = 1
  "m_sample rate": f64 = 1000
  "m_samples": i32 = 1000
  "s_sample rate": f64 = 1000
  "s_samples": i32 = 1000
outputs:
  "Wavefore Message": waveform<f64>
  "Waveform Carrier": waveform<f64>
  "Combined Waveform": waveform<f64>
  "PSD of AM modulated Signal": T1
  "PSD of message": T1
types:
  T1 = cluster{"f0": f64, "df": f64, "magnitude": f64[]}
uses:
  NI::Analysis::Generation::Sine Waveform.gvi
  NI::Analysis::Measurement::Power Spectral Density for 1 Chan.gvi
diagram:
  call "Sine Waveform.gvi"(amplitude=$m_amplitude, frequency=$m_frequency, phase in=90, sample rate=$"m_sample rate", samples=$m_samples) -> (sine wave=w1)
  $"Wavefore Message" <- w1
  call "Power Spectral Density for 1 Chan.gvi"(signal=w1) -> (power spectral density=w2)
  $"PSD of message" <- w2
  call "Sine Waveform.gvi"(amplitude=$s_amplitude, frequency=$s_frequency, phase in=90, sample rate=$"s_sample rate", samples=$s_samples) -> (sine wave=w3)
  Waveform Divide(x=w3, y=$s_amplitude) -> w4
  Waveform Multiply(w1, w4) -> w5
  Waveform Add(w5, w3) -> w6
  call "Power Spectral Density for 1 Chan.gvi"(signal=w6) -> (power spectral density=w7)
  $"PSD of AM modulated Signal" <- w7
  $"Combined Waveform" <- w6
  $"Waveform Carrier" <- w3
