vi "AMCoherent.gvi"   [LabVIEW Communications System Design Suite 2.0.1]
inputs:
  "AM signal": waveform<f64> = {dt=1, Y=[]}
  "carrier": waveform<f64> = {dt=1, Y=[]}
  "Low cutoff frequency": f64 = 0.125
  "order": i32 = 2
  "error in": error
outputs:
  "Demodulated": waveform<f64>
  "error out": error
panel indicators:
  "Demodulated_PSD": T1
types:
  T1 = cluster{"f0": f64, "df": f64, "magnitude": f64[]}
uses:
  NI::Analysis::Measurement::AC DC and RMS (single-shot)(Wfm).gvi
  NI::Analysis::Filtering::Butterworth Lowpass Filter (Waveform).gvi
  NI::Analysis::Measurement::Power Spectral Density for 1 Chan.gvi
diagram:
  Merge Errors($"error in") -> (error out=w1)
  $"error out" <- w1
  call "AC DC and RMS (single-shot)(Wfm).gvi"(signal=$"AM signal") -> (DC value=w2)
  Waveform Multiply($carrier, $"AM signal") -> w3
  call "Butterworth Lowpass Filter (Waveform).gvi"(signal=w3, cutoff frequency=$"Low cutoff frequency", order=$order) -> (filtered signal=w4)
  Waveform Subtract(x=w4, y=w2) -> w5
  $Demodulated <- w5
  call "Power Spectral Density for 1 Chan.gvi"(signal=w5) -> (power spectral density=w6)
  $Demodulated_PSD <- w6
