vi "AMEnvelopeDetection.gvi"   [LabVIEW Communications System Design Suite 2.0.1]
inputs:
  "AM signal": waveform<f64> = {dt=1, Y=[]}
  "Low cutoff frequency": f64 = 0.125
  "order": i32 = 2
  "error in": error
outputs:
  "Demodulated Signal": waveform<f64>
  "Demodulated Signal PSD": T1
  "error out": error
panel indicators:
  "loop count": i32
  "x < 0?": bool
  "output waveform": waveform<f64>
  "element": f64
  "product": i32
types:
  T1 = cluster{"f0": f64, "df": f64, "magnitude": f64[]}
uses:
  NI::Analysis::Filtering::Butterworth Lowpass Filter (Waveform).gvi
  NI::Analysis::Measurement::Power Spectral Density for 1 Chan.gvi
diagram:
  Merge Errors($"error in") -> (error out=w1)
  $"error out" <- w1
  Waveform Array Size(waveform=$"AM signal") -> (size=w2)
  $"loop count" <- w2
  Waveform Multiply($"AM signal", 3.14159265359) -> w3
  for (N = w2) {
    Waveform Index Array(array=w3) -> (out0=w4)
    Is Less Than 0(x=w4) -> w5
    $"x < 0?" <- w5
    $element <- w4
    case (w5) {
      frame False, Default {
        w6 = 1
      }
      frame True {
        w6 = 0
      }
    }
    Multiply(w6) -> w7
    $product <- w7
  }
  Waveform Replace Array Subset(index=w7, waveform=$"AM signal", waveform_subarray=0) -> (output_waveform=w8)
  $"output waveform" <- w8
  call "Butterworth Lowpass Filter (Waveform).gvi"(signal=w8, cutoff frequency=$"Low cutoff frequency", order=$order) -> (filtered signal=w9)
  $"Demodulated Signal" <- w9
  call "Power Spectral Density for 1 Chan.gvi"(signal=w9) -> (power spectral density=w10)
  $"Demodulated Signal PSD" <- w10
