vi "AMTopLevel.gvi"   [LabVIEW Communications System Design Suite 2.0.1]
panel controls:
  "m_frequency": f64 = 10
  "m_amplitude": f64 = 1
  "s_frequency": f64 = 10
  "s_amplitude": f64 = 1
  "m_sample rate": f64 = 1000
  "m_samples": i32 = 1000
  "s_sample rate": f64 = 1000
  "s_samples": i32 = 1000
  "Low cutoff frequency": f64 = 0.125
  "order": i32 = 2
  "stop": bool
panel indicators:
  "Demodulated Signal": waveform<f64>
  "loop iteration": i32
  "Combined AM signal": waveform<f64>
  "Demodulated Waveform": waveform<f64>
  "Demodulated Signal PSD": T1
types:
  T1 = cluster{"f0": f64, "df": f64, "magnitude": f64[]}
diagram:
  while (iteration -> i1) {
    call "AM.gvi"(m_frequency=$m_frequency, m_amplitude=$m_amplitude, s_frequency=$s_frequency, s_amplitude=$s_amplitude, m_sample rate=$"m_sample rate", m_samples=$m_samples, s_sample rate=$"s_sample rate", s_samples=$s_samples) -> (Waveform Carrier=w1, Combined Waveform=w2)
    call "AMCoherent.gvi"(AM signal=w2, carrier=w1, Low cutoff frequency=$"Low cutoff frequency", order=$order) -> (Demodulated=w3)
    $"Demodulated Waveform" <- w3
    call "AMEnvelopeDetection.gvi"(AM signal=w3, Low cutoff frequency=$"Low cutoff frequency", order=$order) -> (Demodulated Signal=w4, Demodulated Signal PSD=w5)
    $"Demodulated Signal" <- w4
    $"Demodulated Signal PSD" <- w5
    $"Combined AM signal" <- w2
    $"loop iteration" <- i1
    stop if $stop
  }
