vi "FM Tx-Rx.gvi"   [LabVIEW NXG]
panel controls:
  "IQ rate Tx": f64 = 500000
  "carrier frequency Tx": f64 = 400000000
  "gain Tx": f64
  "active antenna Tx": string = "TX/RX"
  "IQ rate Rx": f64 = 500000
  "carrier frequency Rx": f64 = 400000000
  "gain Rx": f64
  "active antenna Rx": string = "RX2"
  "Stop Tx": bool
  "Stop Rx": bool
  "Device names Tx": string
  "Device names Rx": string
  "msg. freq.": f64 = 1000
  "msg. amplitude": f64 = 1
  "delta f": f64 = 30000
  "Low cutoff freq": f64 = 10000
  "delta f_demod": f64 = 500
  "number of samples": f64 = 200000
panel indicators:
  "coerced IQ rate Rx": f64
  "coerced carrier frequency Rx": f64
  "coerced gain 2": f64
  "error out": error
  "Demod. Msg (Time domain)": waveform<f64>
  "Demod. Msg (Freq domain)": T1
  "Error Out_2": error
types:
  T1 = cluster{"f0": f64, "df": f64, "magnitude": f64[]}
diagram:
  w1 = $"number of samples"
  w2 = $"IQ rate Tx"
  call "niUSRP Open Tx Session.gvi"(Device names=$"Device names Tx") -> (Error Out=w3, Session handle=w4)
  call "niUSRP Configure Signal.gvi"(session handle=w4, IQ rate=w2, carrier frequency=$"carrier frequency Tx", gain=$"gain Tx", error in (no error)=w3, active antenna=$"active antenna Tx") -> (session handle out=w5, Error Out=w6)
  while {
    Build Cluster(w2, w1) -> w7
    call "Sine Waveform.gvi"(frequency=$"msg. freq.", amplitude=$"msg. amplitude", phase=0, sampling info=w7) -> (signal out=w8)
    Property Node(instance in=w8) -> ("Y"=w9, "dt"=w10)
    call "Integral x(t).gvi"(x=w9, dt=w10) -> (integral x=w11)
    Multiply(PiTimes2, $"delta f") -> w12
    Multiply(w11, w12) -> w13
    Sine And Cosine(x=w13) -> (cos(x)=w14, sin(x)=w15)
    Real And Imaginary To Complex(x=w14, y=w15) -> w16
    call "niUSRP Write Tx Data (CDB).gvi"(session handle=w5, data=w16, end of data?=$"Stop Tx", error in (no error)=w6) -> (session handle out=w17, Error Out=w18)
    Property Node(instance in=w18) -> ("status"=w19)
    Logical Or(w19, $"Stop Tx") -> w20
    stop if w20
  }
  call "niUSRP Close Session.gvi"(Handle in=w17, error in (no error)=w18) -> (Error Out=w21)
  $"error out" <- w21
  call "niUSRP Open Rx Session.gvi"(Device names=$"Device names Rx") -> (Session handle=w22)
  call "niUSRP Configure Signal.gvi"(session handle=w22, IQ rate=$"IQ rate Rx", carrier frequency=$"carrier frequency Rx", gain=$"gain Rx", active antenna=$"active antenna Rx") -> (session handle out=w23, coerced IQ rate=w24, coerced carrier frequency=w25, coerced gain=w26, Error Out=w27)
  $"coerced IQ rate Rx" <- w24
  $"coerced carrier frequency Rx" <- w25
  call "niUSRP Initiate.gvi"(session handle=w23, error in (no error)=w27) -> (session handle out=w28, Error Out=w29)
  while {
    To Quad Integer(number=w1) -> w30
    call "niUSRP Fetch Rx Data (CDB WDT).gvi"(session handle=w28, number of samples=w30, error in (no error)=w29) -> (session handle out=w31, data=w32, Error Out=w33)
    Property Node(instance in=w32) -> ("Y"=w34, "dt"=w35)
    Complex To Real Imaginary(x + iy=w34) -> (x=w36, y=w37)
    call "Derivative x(t).gvi"(x=w36, dt=w35) -> (dx/dt=w38)
    Multiply(w38, w37) -> w39
    Reciprocal(x=w35) -> w40
    call "Butterworth.gvi"(X=w39, sampling freq: fs=w40, low cutoff freq: fl=$"Low cutoff freq", filter type="Lowpass", order=5) -> (Filtered X=w41)
    call "AC & DC Estimator.gvi"(Signal (V)=w41) -> (DC estimate (V)=w42)
    Subtract(x=w41, y=w42) -> w43
    Multiply(PiTimes2, $"delta f_demod") -> w44
    Divide(x=w43, y=w44) -> w45
    Build Waveform Node(Y=w45, dt=w35) -> (output waveform=w46)
    $"Demod. Msg (Time domain)" <- w46
    call "FFT Power Spectrum and PSD for 1 Chan.gvi"(time signal=w46) -> (power spectrum / psd=w47)
    $"Demod. Msg (Freq domain)" <- w47
    Property Node(instance in=w33) -> ("status"=w48)
    Logical Or(w48, $"Stop Rx") -> w49
    stop if w49
  }
  call "niUSRP Abort.gvi"(Handle in=w31, error in (no error)=w33) -> (Handle out=w50, Error Out=w51)
  call "niUSRP Close Session.gvi"(Handle in=w50, error in (no error)=w51) -> (Error Out=w52)
  $"Error Out_2" <- w52
  $"coerced gain 2" <- w26
